# Grasshopper definition pmi.gh (Grasshopper 1.0.8)

path = FilePath("C:\Users\ahmed\OneDrive\Desktop\PMI-1\data\processed\elements.csv")
file = ReadFile(File=path, PerLineParse=True)
path_2 = FilePath("C:\Users\ahmed\OneDrive\Desktop\PMI-1\data\processed\geometry.json")
panel = Panel(file)
py3 = Python3Script(x=path_2)  # -> out, a
# ---------- py3: Python ----------
import json
import Rhino.Geometry as rg

a = []
b = []

if x:
    with open(str(x), "r", encoding="utf-8") as file:
        data = json.load(file)

    for element in data["elements"]:
        vertices = element["vertices"]
        faces = element["faces"]

        mesh = rg.Mesh()

        for i in range(0, len(vertices), 3):
            mesh.Vertices.Add(
                vertices[i],
                vertices[i + 1],
                vertices[i + 2],
            )

        for i in range(0, len(faces), 3):
            mesh.Faces.AddFace(
                faces[i],
                faces[i + 1],
                faces[i + 2],
            )

        mesh.Normals.ComputeNormals()
        mesh.Compact()

        a.append(mesh)
        b.append(element["global_id"])
# ---------- end py3 ----------
